# Grasshopper definition simple.gh (Grasshopper 1.0.7)
# plug-ins: SeemoPredictor

# Scene Geometry
geometry = Geometry([<brep referenced from the Rhino model> x5])
geometry_2 = Geometry([<brep referenced from the Rhino model> x2])
# Single Viewpoint
pt = Point(Point(1.060020935, 0.4267822768, 1.643102183))
brep = Brep(<brep referenced from the Rhino model>)
geometry_3 = Geometry([<brep referenced from the Rhino model> x174])  # disabled
sf = SeemoFace(Geometry=geometry, Type=0)
sf_2 = SeemoFace(Geometry=geometry_2, Type=1)
sf_3 = SeemoFace(Geometry=brep, Type=4)
sf_4 = SeemoFace(Geometry=geometry_3, Type=1)  # disabled
sensor = Sensor(Point=pt, Resolution="40")
viewanalyzer = ViewAnalyzer(Sensors=sensor, Faces=[sf, sf_2, sf_3, sf_4])  # -> ResultFilePath, OverallRatings, ViewContents, ViewAccesses, Privacys, Result
python = GhPythonScript(res=viewanalyzer.Result, p="0", d="0")  # -> out, res; inputs p: Int32, d: Int32
# ---------- python: Python ----------
__author__ = "Timur"
__version__ = "2022.03.03"

import rhinoscriptsyntax as rs

_res =  res.Results[p].DirectionsResults[d]
# ---------- end python ----------
panel = Panel("0")
viewer = ImageViewer(Results=python.res)
visualizer0205 = Visualizer0205(Path=viewanalyzer.ResultFilePath)  # -> OverallRatingGraph, ViewContentGraph, ViewAccessGraph, PrivacyGraph; disabled
# Explode class for debugging
python_2 = GhPythonScript(x=viewanalyzer.Result, y=panel)  # -> out, pt, dir, d, c, b, a, e; inputs y: Int32
# ---------- python_2: Python ----------
__author__ = "Timur"
__version__ = "2022.03.03"

import rhinoscriptsyntax as rs

img = x.Results[0].DirectionsResults[y].Image

pt = rs.CreateVector(img.Pt.X, img.Pt.Y, img.Pt.Z)
dir = rs.CreateVector(img.Dir.X, img.Dir.Y, img.Dir.Z)

b = rs.CreateVector(img.TopCorner.X, img.TopCorner.Y, img.TopCorner.Z)
d = rs.CreateVector(img.xAxis.X, img.xAxis.Y, img.xAxis.Z)
c = rs.CreateVector(img.yAxis.X, img.yAxis.Y, img.yAxis.Z)

iray = x.Results[0].DirectionsResults[y].Image.ImageRaysFlat

pixrays = []
for i in iray:
  pixrays.append(rs.CreateVector(i.X, i.Y, i.Z))
a = pixrays


_hits = x.Results[0].DirectionsResults[y].Image.HitsFlat
hits = []
for i in _hits:
  hits.append(rs.CreatePoint(i.X, i.Y, i.Z))
e = hits
# ---------- end python_2 ----------
mesh = Mesh(visualizer0205.OverallRatingGraph)  # disabled
mesh_2 = Mesh(visualizer0205.ViewContentGraph)  # disabled
mesh_3 = Mesh(visualizer0205.PrivacyGraph)  # disabled
mesh_4 = Mesh(visualizer0205.ViewAccessGraph)  # disabled
vdisex = VectorDisplayEx(Point=python_2.pt, Vector=expr("x*10", [python_2.b, python_2.c, python_2.d, python_2.dir]), Colour=RGB(0, 0, 0), Width=2)
vdisex_2 = VectorDisplayEx(Point=python_2.pt, Vector=expr("x*10", python_2.a), Colour=RGB(0, 0, 0), Width=2)
